# Grasshopper definition MODEL_PROOF.gh (Grasshopper 1.0.8)
# Copyright: 2017
# plug-ins: Bifocals

# Chose the threshold distance
# to be slightly bigger than the
# size of the 3D model
click_to_select_objects_far_from_zero = Button()
# Click play to calculate
# precise volume intersections.
# Switch view in transparent mode
# to see the intersecting volumes.
# (it can take up to 15 minutes, for
# better performance input small
# groups of Objects)
threshold_distance_cm = DigitScroller(Scroller_Digits=12, Scroller_Prefix="Threshold distance (cm)", Scroller_Radix=9, Scroller_Value=20000)

# ----
# Relay
# Colour Swatch
# Guid
# Python 3 Script
# Data
# C# Script
# Data Dam
# Brep
# Custom Preview
# Digit Scroller
# STEP 0:
# -LOAD YOUR BREPS HERE
# (Load semantically segmented models.
# Granular models with simple mathematics
# are faster to compute)
# Load all Rhino geometry here,
# (use Ctrl+A on Rhino viewport
# to load eventual out of view
# geometry, then right click on
# the Grasshopper node to
# "set multiple Breps")
# Load NURBS Geometry
right_click_this_node_and_click_set_mult = Brep()  # "Right click this node and click \"Set Multiple Breps\""

clean = CleanTree(RemoveNulls=True, RemoveInvalid=False, RemoveEmpty=False, Tree=right_click_this_node_and_click_set_mult)
# FOLLOW THE STEPS IN THIS ORDER
# STEP 1:
# -SELECT INVALID OBJECTS
# (erase or remodel them manually)
data = Data(clean)
threshold_distance = Data(threshold_distance_cm)
data_2 = Data(click_to_select_objects_far_from_zero)
threshold_distance_2 = Data(threshold_distance)

# ---- group: boolean toggle to select geometry
# STEP 5:
# -ADD GROUPS OF CLOSED BREPS
# -SELECT OBJECTS THAT COLLIDE AND INTERSECT
# -ERASE OR CORRECT THEM
# (input small groups of objects to reduce computation times)
boolean_toggle = Data(data_2)

# ---- group: Click play to load input geometry
uploaded_objects = Brep(data)

# ----
data_3 = Data(uploaded_objects)

# ----
# Find invalid objects via
# "validity_results.append"
# Python script
py3 = Python3Script(breps=data_3)  # -> out, invalid; inputs breps: list of Brep
# ---------- py3: Python ----------
import Rhino.Geometry as rg

# Definizione di una variabile globale per memorizzare i risultati di validità
validity_results = []

# Inputs
breps = breps  # Lista di Breps da controllare

# Ciclo per verificare la validità di ogni Brep
for brep in breps:
    if isinstance(brep, rg.Brep):
        # Verifica se la Brep è valida
        is_valid = brep.IsValid
        if is_valid:
            validity_results.append(False)  # Brep è valida
        else:
            validity_results.append(True)  # Brep non è valida
    else:
        # Se l'oggetto non è una Brep, considera il risultato come non valido
        validity_results.append(True)

# Output
invalid = validity_results  # Output della lista di booleani
# ---------- end py3 ----------

# ----
# Cull invalid objects
# from input list
cull = CullPattern(List=data_3, CullPattern=invert(py3.invalid))
updated_list_of_objects = Data(cull)

data_4 = Data(updated_list_of_objects)
# STEP 2:
# -SELECT OPEN OBJECTS
# (erase or cap them manually)
data_5 = Data(data_4)

# ---- group: input geometry
updated_list_of_objects_2 = Brep(data_5)

# ----
# Find naked edges
edges = BrepEdges(Brep=updated_list_of_objects_2)  # -> Naked, Interior, NonManifold
lng = ListLength(List=edges.Naked)  # -> flatten(Length)
larger = LargerThan(FirstNumber=lng, SecondNumber="0")  # -> LargerThan, OrEqualTo

# ----
# Cull open objects
# from input list
cull_2 = CullPattern(List=updated_list_of_objects_2, CullPattern=invert(larger.LargerThan))
updated_list_of_objects_3 = Data(cull_2)

data_6 = Data(updated_list_of_objects_3)
data_7 = Data(data_6)

# ---- group: input geometry
updated_list_of_objects_4 = Brep(data_7)

# ----
# Select duplicate Breps
# (brep.IsDuplicate)
python_3_script = Python3Script(breps=updated_list_of_objects_4)  # -> out, unique_breps_list, duplicate_breps_list, duplicate_indices_list; inputs breps: list of GeometryBase
# ---------- python_3_script: Python ----------
import Rhino.Geometry as rg
import scriptcontext as sc

# Lista delle polisuperfici in input
input_breps = breps  # Assumendo 'breps' come l'input delle polisuperfici in Grasshopper

# Dizionario per memorizzare le polisuperfici uniche
unique_breps = {}
duplicate_breps = {}

# Tolleranza per il confronto di geometrie (può essere regolato in base alle esigenze)
tolerance = sc.doc.ModelAbsoluteTolerance

for index, brep in enumerate(input_breps):
    is_duplicate = False
    for key, unique_brep in unique_breps.items():
        # Confronto le polisuperfici basato sulla geometria e sulla tolleranza
        if brep.IsDuplicate(unique_brep, tolerance):
            is_duplicate = True
            # Aggiungi l'oggetto duplicato al dizionario e memorizza l'indice dell'oggetto unico
            duplicate_breps[brep] = index
            break
    
    if not is_duplicate:
        unique_breps[brep] = brep

# Estrai solo le polisuperfici uniche dal dizionario
unique_breps_list = list(unique_breps.values())
duplicate_breps_list = list(duplicate_breps.keys())
duplicate_indices_list = list(duplicate_breps.values())  # Lista degli indici degli oggetti duplicati

# Ora unique_breps_list contiene le polisuperfici uniche
# duplicate_breps_list contiene le polisuperfici duplicate
# duplicate_indices_list contiene gli indici degli oggetti duplicati

# Output desiderato: unique_breps_list, duplicate_breps_list, duplicate_indices_list
# ---------- end python_3_script ----------

# ----
# Cull dups from
# input list
cull_i = CullIndex(List=updated_list_of_objects_4, Indices=python_3_script.duplicate_indices_list, Wrap=True)
updated_list = Data(cull_i)

data_8 = Data(updated_list)
data_9 = Data(data_8)

# ---- group: input geometry
updated_list_of_objects_5 = Brep(data_9)

# ----
debrep = DeconstructBrep(Brep=updated_list_of_objects_5)  # -> Faces, Edges, Vertices
avr = Average(Input=debrep.Vertices)  # -> flatten(ArithmeticMean)
dist = Distance(PointA=avr, PointB="0,0,0")
larger_2 = LargerThan(FirstNumber=dist, SecondNumber=threshold_distance_2)  # -> LargerThan, OrEqualTo

# ----
# Cull far objects
# from input list
cull_3 = CullPattern(List=updated_list_of_objects_5, CullPattern=invert(larger_2.LargerThan))
updated_list_2 = Data(cull_3)

# ----
# Select duplicates
# in Rhino viewport
id = Guid(updated_list_of_objects_5)
cull_4 = CullPattern(List=id, CullPattern=larger_2.LargerThan)
py3_2 = Python3Script(x=cull_4, y=boolean_toggle)  # -> out, a; inputs x: list of String, y: Boolean
# ---------- py3_2: Python ----------
import Rhino
import scriptcontext as sc
import System

# Assicurati di operare sul documento attivo
sc.doc = Rhino.RhinoDoc.ActiveDoc

def select_objects_by_id(object_ids):
    # Deseleziona tutti gli oggetti nel documento
    deselect_all_objects()
    
    # Lista per tenere traccia degli oggetti trovati e selezionati
    selected_ids = []
    
    print("Selection activated.")
    # Itera su ciascun ID
    for obj_id in object_ids:
        try:
            # Converte la stringa in GUID
            guid = System.Guid(obj_id)
            
            # Trova l'oggetto in base al GUID
            obj = sc.doc.Objects.Find(guid)
            
            if obj:
                # Seleziona l'oggetto
                obj.Select(True)
                selected_ids.append(obj_id)
                print(f"Selected object ID: {obj_id}")
            else:
                print(f"Object ID {obj_id} not found in the document.")
        except Exception as e:
            print(f"Error with ID {obj_id}: {e}")
    
    # Aggiorna la vista per riflettere le selezioni
    sc.doc.Views.Redraw()
    
    return selected_ids

def deselect_all_objects():
    # Utilizza RhinoCommon per deselezionare tutti gli oggetti
    for obj in sc.doc.Objects:
        if obj.IsSelected(False) > 0:
            obj.Select(False)

# Inputs
object_ids = x  # Assumendo che x sia già una lista di ID
button_pressed = y  # Booleano generato dal pulsante

# Verifica che il documento attivo sia corretto
print("Active Document:", sc.doc)

# Se il pulsante è premuto, esegui la selezione
selected_objects = []
if button_pressed:
    selected_objects = select_objects_by_id(object_ids)

# Output
a = selected_objects
# ---------- end py3_2 ----------

# ----
# Text alert if errors
# are detected
panel = Panel("Far Objects Detected")
lng_2 = ListLength(List=cull_4)
concat = Concatenate(FragmentE="[", FragmentA=lng_2, FragmentD="]", FragmentB=" ", FragmentC=panel)
panel_2 = Panel(concat)

panel_3 = Panel(panel_2)
data_10 = Data(updated_list_2)
data_11 = Data(data_10)

# ---- group: input geometry
updated_list_of_objects_6 = Brep(data_11)

# ----
# Find wrong geometry
# Increase the volume threshold
# to remove false positives
volume_threshold = DigitScroller(Scroller_Digits=12, Scroller_Prefix="Volume threshold", Scroller_Radix=6, Scroller_Value=0.001)
click_to_select_intersecting_objects = Button()
click_to_select_invalid_objcets = Button()
click_to_select_open_objects = Button()
click_to_select_duplicate_objects = Button()

data_12 = Data(click_to_select_invalid_objcets)
data_13 = Data(click_to_select_open_objects)
data_14 = Data(click_to_select_duplicate_objects)
data_15 = Data(click_to_select_intersecting_objects)

# ---- group: boolean toggle to select geometry
boolean_toggle_2 = Data(data_12)

boolean_toggle_3 = Data(data_15)

# STEP 3:
# -SELECT DUPLICATE OBJECTS
# (erase them manually)
boolean_toggle_4 = Data(data_13)

# STEP 4:
# -FIND OBJECTS FAR FROM ZERO
# (erase them manually)
boolean_toggle_5 = Data(data_14)

# ----
# Select open Breps
# in Rhino viewport
id_2 = Guid(updated_list_of_objects_2)
cull_5 = CullPattern(List=id_2, CullPattern=larger.LargerThan)
py3_3 = Python3Script(x=cull_5, y=boolean_toggle_4)  # -> out, a; inputs x: list of String, y: Boolean; same code as py3_2

# ----
# Select ivalid objects
# in Rhino viewport
id_3 = Guid(data_3)
cull_6 = CullPattern(List=id_3, CullPattern=py3.invalid)
py3_4 = Python3Script(x=cull_6, y=boolean_toggle_2)  # -> out, a; inputs x: list of String, y: Boolean; same code as py3_2

# ----
# Select duplicates
# in Rhino viewport
id_4 = Guid(updated_list_of_objects_4)
item = ListItem(List=id_4, Index=python_3_script.duplicate_indices_list, Wrap=True)
py3_5 = Python3Script(x=item, y=boolean_toggle_5)  # -> out, a; inputs x: list of String, y: Boolean; same code as py3_2

# ----
# Text alert if errors
# are detected
panel_4 = Panel("Open Objects Detected")
lng_3 = ListLength(List=cull_5)
concat_2 = Concatenate(FragmentD="[", FragmentA=lng_3, FragmentE="]", FragmentB=" ", FragmentC=panel_4)
panel_5 = Panel(concat_2)

# ----
# Text alert if errors
# are detected
panel_6 = Panel("Invalid Objects Detected")
lng_4 = ListLength(List=cull_6)
concat_3 = Concatenate(FragmentD="[", FragmentA=lng_4, FragmentE="]", FragmentB=" ", FragmentC=panel_6)
panel_7 = Panel(concat_3)

# ----
# Text alert if errors
# are detected
panel_8 = Panel("Duplicate Objects Detected")
lng_5 = ListLength(List=item)
concat_4 = Concatenate(FragmentE="[", FragmentA=lng_5, FragmentD="]", FragmentB=" ", FragmentC=panel_8)
panel_9 = Panel(concat_4)

# ----
# Change intersection color
swatch = ColourSwatch(SwatchColor=RGB(255, 0, 0))

# ---- group: Data Dam (moved to input panel)
data_dam = Data(updated_list_of_objects_6)

# ----
dam = DataDam(DataA=data_dam, BufferDelay=10000000, BufferMode=0)

# ---- group: Data Dam (moved to input panel) (continued)
data_dam_2 = Data(dam)

# ----
# Filter Breps by intersecting
# Bounding Boxes
# (rg.BoundingBox.Intersection)
py3_6 = Python3Script(breps=data_dam_2)  # -> collisions; inputs breps: list of Brep
# ---------- py3_6: Python ----------
"""
Script Python per Grasshopper (GhPython)
Input:
    breps: list di Brep (chiusi)
Output:
    collisions: DataTree con gli indici dei Brep che hanno bounding box in collisione (no solo contatto)
"""

import Rhino.Geometry as rg
from Grasshopper import DataTree
from Grasshopper.Kernel.Data import GH_Path
import scriptcontext as sc

collisions = DataTree[int]()  # albero di indici

if breps:
    # Precalcola tutte le bounding box (tight)
    bboxes = [b.GetBoundingBox(True) for b in breps]

    tol = sc.doc.ModelAbsoluteTolerance

    for i, bb1 in enumerate(bboxes):
        path = GH_Path(i)  # <-- parte da 0

        for j, bb2 in enumerate(bboxes):
            if i == j:
                continue

            inters = rg.BoundingBox.Intersection(bb1, bb2)
            if inters and inters.IsValid:
                dx = inters.Max.X - inters.Min.X
                dy = inters.Max.Y - inters.Min.Y
                dz = inters.Max.Z - inters.Min.Z

                # escludi casi di solo contatto (nessuna dimensione > tol)
                if dx > tol and dy > tol and dz > tol:
                    collisions.Add(j, path)

        # garantisco che il ramo esista anche se vuoto
        if collisions.Branch(path) is None:
            collisions.EnsurePath(path)
# ---------- end py3_6 ----------

# ----
# Boolean intersection
# (slow)
graft = GraftTree(Tree=data_dam_2, IncludeEmptyLists=True, IncludeNullItems=True)  # -> simplify(Tree)
item_2 = ListItem(List=data_dam_2, Index=py3_6, Wrap=True)  # -> simplify(Item)
sint = SolidIntersection(BrepsA=graft, BrepsB=item_2)

# ----
# Filter objects with atl
# east one intersection
clean_2 = CleanTree(RemoveNulls=True, RemoveInvalid=True, RemoveEmpty=False, Tree=sint)
lng_6 = ListLength(List=clean_2)
larger_3 = LargerThan(FirstNumber=lng_6, SecondNumber="1")  # -> LargerThan, flatten(OrEqualTo)

# ----
# Filter intersections smaller
# than threshold
volume_threshold_2 = Data(volume_threshold)
volume = Volume(Geometry=clean_2)  # -> Volume, Centroid
larger_4 = LargerThan(FirstNumber=volume.Volume, SecondNumber=volume_threshold_2)  # -> LargerThan, OrEqualTo
cull_7 = CullPattern(List=clean_2, CullPattern=larger_4.LargerThan)

preview = CustomPreview(Geometry=cull_7, Material=swatch)

# ----
# Filter lists of operators based on volume of result
int = Integer(larger_4.LargerThan)
mm = MassMultiplication(Input=int)  # -> Result, PartialResults
larger_5 = LargerThan(FirstNumber=mm.Result, SecondNumber="1")  # -> LargerThan, flatten(OrEqualTo)
id_5 = Guid(simplify(graft(data_dam_2)))
viewer = ParamViewer(id_5)
cull_8 = CullPattern(List=viewer, CullPattern=larger_5.OrEqualTo)
branch = TreeBranch(Tree=id_5, Path=cull_8, MaintainPaths=True)  # -> flatten(Branch)

# ----
# Select intersecting
# objets in Rhino
py3_7 = Python3Script(x=branch, y=boolean_toggle_3)  # -> out, a; inputs x: list of String, y: Boolean; same code as py3_2

# ----
# Text alert if errors
# are detected
panel_13 = Panel("Intersecting Objects Detected")
lng_7 = ListLength(List=branch)
concat_5 = Concatenate(FragmentD="[", FragmentA=lng_7, FragmentE="]", FragmentB=" ", FragmentC=panel_13)
panel_14 = Panel(concat_5)
